# Grasshopper definition Shelfer.gh (Grasshopper 1.0.7)
# plug-ins: Heteroptera, EleFront, OpenNest

cabineo_hole_depth = Slider(10.7, range=0..20)
indent_depth = Slider(0.5, range=0..1)
rearcutoff = Slider(1, range=0..10)
xmargin = Slider(15, range=0..100)
ymargin = Slider(15, range=0..100)
includehardware = BooleanToggle(True)
use15mmdrill = BooleanToggle(True)
panel = Panel("""1250x2410
1250x2410
1250x2410
1250x2410""")
path = FilePath("C:\Users\alexa\Downloads\Hicks\")

platedata = PlateData(T="*", P=path)  # -> platecompartmentid, length, depth, thickness, type, position, rotation, sockets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
sheets = Sheets(xmargin=xmargin, rearcutoff=rearcutoff, dimensions=panel, ymargin=ymargin)  # -> offsets, frontsheets, rearsheets
milling_bit_size_mm = Slider(4, range=0..15)
panel_2 = Panel(sheets.offsets)
plate = Plate(
    cutouts=platedata.cutouts,
    type=platedata.type,
    depth=platedata.depth,
    thickness=platedata.thickness,
    cabineoholedepth=cabineo_hole_depth,
    indentdepth=indent_depth,
    length=platedata.length,
    sockets=platedata.sockets,
    mounts=platedata.mounts,
    use15mmdrill=use15mmdrill,
    includehardware=includehardware,
    cabineoside=platedata.cabineoside,
    hingecups=platedata.hingecups)
frame = Frame(positions=platedata.position, plates=plate, rotations=platedata.rotation)
extra_gap = Slider(1, range=0..5)
pt = ConstructPoint(XCoordinate=0, YCoordinate=panel_2, ZCoordinate=0)
addition = Addition(A=extra_gap, B=milling_bit_size_mm)
item = ListItem(List=platedata.thickness, Index=0, Wrap=True)
opennest = OpenNest(
    Sheets=sheets.frontsheets,
    Geo=flatten(plate),
    Spacing=addition,
    Placement="1",
    Tolerance=0.1,
    Rotations="4",
    Iterations="10",
    Seed="2",
    Reset=True,
    Run=False)  # -> Sheets, Geo, ID, Transform, IDS
reflay = ReferenceByLayer(LayerName="ManSheets")
list = ValueList({"elefront"}, selected="elefront")
refbake = ReferenceByBakeName(BakeName=list, Key="*", Val="*", maintainStructure=False)
_2ddrawing = _2dDrawing(
    rearcutoff=rearcutoff,
    rearsheets=sheets.rearsheets,
    sheetoffsets=sheets.offsets,
    thickness=flatten(item),
    plates=opennest.Geo,
    millingbitsize=milling_bit_size_mm,
    cabineoholedepth_2=cabineo_hole_depth,
    ids=flatten(platedata.platecompartmentid),
    cabineoholedepth=cabineo_hole_depth,
    indentdepth=indent_depth)  # -> sheets, rearholes, throughholes, drillholes, sockets, plates_2, idtexts_2, indents
bake_switch = BooleanToggle(False)
center = Center(Geometrical=refbake)  # -> Center, Dimension
export = ExportObjects(FileExtension=".3dm", AxisSystem=PlaneXY(0, 0, 0), Export=False)
bake = Bake(
    rearholes=_2ddrawing.rearholes,
    holes=_2ddrawing.drillholes,
    sockets=_2ddrawing.sockets,
    plates=_2ddrawing.plates_2,
    B=bake_switch,
    origins=pt,
    idtexts=_2ddrawing.idtexts_2,
    indents=_2ddrawing.indents,
    sheets=_2ddrawing.sheets,
    thrroughholes=_2ddrawing.throughholes)

# ==== cluster Plate
panel = Panel("30")
thickness = ClusterInput()
sockets = ClusterInput()
cabineoside = ClusterInput()
depth = ClusterInput()
mounts = ClusterInput()
cabineoholedepth = ClusterInput()
length = ClusterInput()
type = ClusterInput()
hingecups = ClusterInput()
expression = Expression(x=depth, Expression="x/2")
expression_2 = Expression(x=thickness, Expression="x/2")
_2 = _2(x=length)
indentdepth = ClusterInput()
cutouts = ClusterInput()
cluster = Cluster(cutouts=cutouts, Z=expression_2, X=_2, Y=expression)
use15mmdrill = ClusterInput()
cabineosockets = CabineoSockets(
    use15mmdrill=use15mmdrill,
    cabineoholedepth=cabineoholedepth,
    zoffset=expression_2,
    sockets=sockets,
    indentdepth=indentdepth,
    cabineoside=cabineoside)  # -> sockets_2, indents
hingecups_2 = HingeCups(thickness=thickness, hingecups=hingecups, length=length, depth=depth)
drillholes = DrillHoles(mounts=mounts, zoffset=expression_2, thickness=thickness)
merge = Merge(Data1=cabineosockets.sockets_2, Data2=drillholes, Data3=hingecups_2)
includehardware = ClusterInput()
boolgate = GhPythonScript(toggle=includehardware, ifTrue=merge)  # -> result
# ---------- boolgate: Python ----------
__author__ = "alexa"
__version__ = "2020.06.17"

import rhinoscriptsyntax as rs
if (toggle):
    result = ifTrue
else:
    result = ifFalse
# ---------- end boolgate ----------
boolgate_2 = GhPythonScript(toggle=includehardware, ifTrue=cabineosockets.indents)  # -> result; same code as boolgate
sdiff = SolidDifference(BrepsA=cluster, BrepsB=boolgate)
sdiff_2 = SolidDifference(BrepsA=sdiff, BrepsB=boolgate_2)
python = GhPythonScript(indents=cabineosockets.indents, plateWithoutIndents=sdiff, plateWithIndents=sdiff_2)  # -> plates
# ---------- python: Python ----------
__author__ = "alexa"
__version__ = "2019.12.13"

import rhinoscriptsyntax as rs
if (indents is None):
    plates = plateWithoutIndents
else:
    plates = plateWithIndents
# ---------- end python ----------
boolgate_3 = GhPythonScript(toggle=includehardware, ifTrue=python, ifFalse=cluster)  # -> result; same code as boolgate
# Double solid difference here because of small placement indents. Should be imporoved.
clean = CleanTree(RemoveNulls=True, RemoveInvalid=True, RemoveEmpty=False, Tree=boolgate_3)
fmerge = MergeFaces(Brep=clean)  # -> Breps, Before, After
trim = TrimTree(Tree=fmerge.Breps, Depth=1)
plate = ClusterOutput(trim)

# ==== cluster PlateData
P = ClusterInput()
dir = DirectoryContents(FolderPath=P, Filter="*", IncludeSubfolders=Toggle(True))  # -> FilePaths, FileNames
panel = Panel(dir.FilePaths)
make_inline = PythonScript(FilePath=dir.FilePaths)  # -> inline_string
# ---------- make_inline: Python ----------
import json

if FilePath:
    
    # JSON file to read
    file = open(FilePath)
    
    data = file.read().replace('\n', '')
    
    print data
# ---------- end make_inline ----------
frmjson = FromJSON(JSON=make_inline)
panel_2 = Panel(make_inline)
T = ClusterInput()
join = TextJoin(Text=["$.plates[", T, "]"])
join_2 = TextJoin(Text=[join, ".sockets"])
join_3 = TextJoin(Text=[join, ".bottomPartDepth"])
join_4 = TextJoin(Text=[join, ".cabineoSide"])
join_5 = TextJoin(Text=[join, ".bottomPartStart"])
join_6 = TextJoin(Text=[join, ".mounts"])
join_7 = TextJoin(Text=[join, ".hingeCups"])
join_8 = TextJoin(Text=[join, ".cutouts"])
jpath = JSONPath(JObject=frmjson, JSONPathQuery=join_3)
jpath_2 = JSONPath(JObject=frmjson, JSONPathQuery=join_6)
jpath_3 = JSONPath(JObject=frmjson, JSONPathQuery=join_4)
jpath_4 = JSONPath(JObject=frmjson, JSONPathQuery=join_2)
jpath_5 = JSONPath(JObject=frmjson, JSONPathQuery=join_7)
jpath_6 = JSONPath(JObject=frmjson, JSONPathQuery=join_5)
jpath_7 = JSONPath(JObject=frmjson, JSONPathQuery=join_8)
join_9 = TextJoin(Text=[join, ".position"])
join_10 = TextJoin(Text=[join, ".rotation"])
join_11 = TextJoin(Text=[join, ".thickness"])
join_12 = TextJoin(Text=[join, ".plateId"])
join_13 = TextJoin(Text=[join, ".depth"])
join_14 = TextJoin(Text=[join, ".length"])
join_15 = TextJoin(Text=[join, ".type"])
join_16 = TextJoin(Text=[join, ".compartmentId"])
python = GhPythonScript(x=jpath_4)  # -> a
# ---------- python: Python ----------
__author__ = "alexa"
__version__ = "2019.09.16"

import rhinoscriptsyntax as rs
import json

a = [];
arrayList = json.loads(x)

for value in arrayList:
    a.append(value)
if len(arrayList) == 0:
    a.append(None)
# ---------- end python ----------
python_2 = GhPythonScript(x=jpath_2)  # -> a
# ---------- python_2: Python ----------
__author__ = "alexa"
__version__ = "2019.09.16"

import rhinoscriptsyntax as rs
import json

a = [];
if x != "[]":
    arrayList = json.loads(x)
    for value in arrayList:
        a.append(value)
else:
    a.append(None)
# ---------- end python_2 ----------
python_3 = GhPythonScript(x=jpath_5)  # -> a; same code as python_2
jpath_8 = JSONPath(JObject=frmjson, JSONPathQuery=join_9)
python_4 = GhPythonScript(x=jpath_7)  # -> a; same code as python_2
jpath_9 = JSONPath(JObject=frmjson, JSONPathQuery=join_10)
python_5 = GhPythonScript(x=jpath)  # -> R
# ---------- python_5: Python ----------
__author__ = "alexa"
__version__ = "2020.03.15"

import rhinoscriptsyntax as rs
if (x is not None and x is not ""):
    R = x
else:
    R = None
# ---------- end python_5 ----------
python_6 = GhPythonScript(x=jpath_6)  # -> R; same code as python_5
jpath_10 = JSONPath(JObject=frmjson, JSONPathQuery=join_11)
jpath_11 = JSONPath(JObject=frmjson, JSONPathQuery=join_12)
jpath_12 = JSONPath(JObject=frmjson, JSONPathQuery=join_13)
jpath_13 = JSONPath(JObject=frmjson, JSONPathQuery=join_14)
jpath_14 = JSONPath(JObject=frmjson, JSONPathQuery=join_15)
jpath_15 = JSONPath(JObject=frmjson, JSONPathQuery=join_16)
python_7 = GhPythonScript(x=jpath_8)  # -> x, y, z
# ---------- python_7: Python ----------
__author__ = "alexa"
__version__ = "2019.09.16"

import rhinoscriptsyntax as rs
import json

object = json.loads(x)

x = object["x"]
y = object["y"]
z = object["z"]
# ---------- end python_7 ----------
python_8 = GhPythonScript(x=jpath_9)  # -> x, y, z; same code as python_7
pt = ConstructPoint(XCoordinate=python_7.x, YCoordinate=python_7.y, ZCoordinate=python_7.z)
vec = VectorXYZ(XComponent=python_8.x, YComponent=python_8.y, ZComponent=python_8.z)  # -> Vector, Length
length = ClusterOutput(jpath_13)
depth = ClusterOutput(jpath_12)
thickness = ClusterOutput(jpath_10)
type = ClusterOutput(jpath_14)
sockets = ClusterOutput(python)
hingecups = ClusterOutput(python_3)
bottompartdepth = ClusterOutput(python_5)
python_9 = GhPythonScript(x=jpath_15, y=jpath_11)  # -> plateCompartmentId
# ---------- python_9: Python ----------
__author__ = "alexa"
__version__ = "2019.11.05"

import rhinoscriptsyntax as rs
if not x:
    plateCompartmentId = y
else:
    plateCompartmentId = x
# ---------- end python_9 ----------
mounts = ClusterOutput(python_2)
cabineoside = ClusterOutput(jpath_3)
panel_3 = Panel(jpath_11)
bottompartstart = ClusterOutput(python_6)
cutouts = ClusterOutput(python_4)
rotation = ClusterOutput(vec.Vector)
position = ClusterOutput(pt)
platecompartmentid = ClusterOutput(python_9)
python_10 = GhPythonScript()  # -> R
# ---------- python_10: Python ----------
__author__ = "alexa"
__version__ = "2020.03.15"

import rhinoscriptsyntax as rs
from decimal import Decimal
if (x is not None and x is not ""):
    R = x
else:
    R = None
# ---------- end python_10 ----------
python_11 = GhPythonScript()  # -> R; same code as python_10

# ==== cluster Frame
rotations = ClusterInput()
plates = ClusterInput()
devec = DeconstructVector(Vector=rotations)  # -> XComponent, YComponent, ZComponent
equals = Equality(FirstNumber=devec.XComponent, SecondNumber="0")  # -> Equality, Inequality
pi = Pi(Factor=devec.XComponent)
equals_2 = Equality(FirstNumber=devec.YComponent, SecondNumber="0")  # -> Equality, Inequality
equals_3 = Equality(FirstNumber=devec.ZComponent, SecondNumber="0")  # -> Equality, Inequality
yz = YZPlane(Origin=Point(0, 0, 0))
rotate = Rotate(Geometry=plates, Angle=pi, Plane=yz)  # -> Geometry, Transform
python = GhPythonScript(shouldRotate=equals.Inequality, ifTrue=rotate.Geometry, ifFalse=plates)  # -> plate
# ---------- python: Python ----------
__author__ = "alexa"
__version__ = "2019.09.25"

import rhinoscriptsyntax as rs

if shouldRotate:
    plate = ifTrue
else:
    plate = ifFalse
# ---------- end python ----------
pi_2 = Pi(Factor=devec.YComponent)
xz = XZPlane(Origin=Point(0, 0, 0))
rotate_2 = Rotate(Geometry=python, Angle=pi_2, Plane=xz)  # -> Geometry, Transform
python_2 = GhPythonScript(shouldRotate=equals_2.Inequality, ifTrue=rotate_2.Geometry, ifFalse=python)  # -> plate; same code as python
pi_3 = Pi(Factor=devec.ZComponent)
xy = XYPlane(Origin=Point(0, 0, 0))
rotate_3 = Rotate(Geometry=python_2, Angle=pi_3, Plane=xy)  # -> Geometry, Transform
positions = ClusterInput()
python_3 = GhPythonScript(shouldRotate=equals_3.Inequality, ifTrue=rotate_3.Geometry, ifFalse=python_2)  # -> plate; same code as python
move = Move(Geometry=python_3, Motion=positions)  # -> Geometry, Transform
bookcase = ClusterOutput(move.Geometry)

# ==== cluster _2dDrawing
plates = ClusterInput()
debrep = DeconstructBrep(Brep=plates)  # -> Faces, Edges, Vertices
thickness = ClusterInput()
separate_curves = SeparateCurves(C=debrep.Edges)  # -> out, Line, Arc, Polyline, Open, Closed, BBox; inputs C: Curve
# ---------- separate_curves: VB usings ----------
Imports System.IO
Imports System.Linq
Imports System.Data
Imports System.Drawing
Imports System.Reflection
Imports System.Windows.Forms
Imports System.Xml
Imports System.Xml.Linq
Imports Microsoft.VisualBasic
Imports System.Runtime.InteropServices

Imports Rhino.DocObjects
Imports Rhino.Collections
Imports GH_IO
Imports GH_IO.Serialization
# ---------- separate_curves: VB ----------
    If C.IsLinear Then
      Line = C
    Else If (C.IsArc or C.IsPlanar) Then
      Arc = C
    Else If C.IsPolyline Then
      Polyline = C
    Else If C.IsClosed Then
      Closed = C
    Else
      Open = C
    End If
    BBox = C.GetBoundingBox(true).Center.Z
# ---------- end separate_curves ----------
expression = Expression(x=thickness, Expression="x/2")
panel = Panel(separate_curves.BBox)
expression_2 = Expression(x=thickness, Expression="-x/2")
txt = Text(separate_curves.BBox)
txt_2 = Text(expression)
txt_3 = Text(expression_2)
crv = Curve(separate_curves.Line)
toggle = BooleanToggle(True)
python = GhPythonScript(crv=separate_curves.Arc, zTop=txt_2, z=txt)  # -> a
# ---------- python: Python ----------
__author__ = "alexa"
__version__ = "2019.10.04"

import rhinoscriptsyntax as rs

if z == zTop:
    a = crv;
# ---------- end python ----------
python_2 = GhPythonScript(crv=separate_curves.Arc, zBottom=txt_3, z=txt)  # -> a
# ---------- python_2: Python ----------
__author__ = "alexa"
__version__ = "2019.10.04"

import rhinoscriptsyntax as rs

if z == zBottom:
    a = crv;
# ---------- end python_2 ----------
clean = CleanTree(RemoveNulls=True, RemoveInvalid=True, RemoveEmpty=True, Tree=python_2)
clean_2 = CleanTree(RemoveNulls=True, RemoveInvalid=True, RemoveEmpty=True, Tree=python)
len = Length(Curve=separate_curves.Line)
join = JoinCurves(Curves=clean, Preserve=False)
join_2 = JoinCurves(Curves=clean_2, Preserve=False)
separate_curves_2 = SeparateCurves(C=join)  # -> Closed, Open; inputs C: Curve
# ---------- separate_curves_2: VB ----------
    If C.IsClosed Then
      Closed = C
    Else
      Open = C
    End If
# ---------- end separate_curves_2 ----------

geo = Geometry(separate_curves.Arc)
separate_curves_3 = SeparateCurves(C=geo)  # -> Closed, Open; inputs C: Curve; same code as separate_curves_2
python_3 = GhPythonScript(crv=separate_curves_3.Open, zBottom=txt_3, z=txt)  # -> a; same code as python_2
python_4 = GhPythonScript(crv=crv, zBottom=txt_3, z=txt)  # -> a; same code as python_2
clean_3 = CleanTree(RemoveNulls=True, RemoveInvalid=True, RemoveEmpty=True, Tree=[python_4, python_3])
join_3 = JoinCurves(Curves=clean_3, Preserve=False)
project = Project(Geometry=join_3, Plane=PlaneXY(0, 0, 0))  # -> Geometry, Transform
plates_2 = ClusterOutput(project.Geometry)

separate_curves_4 = SeparateCurves(C=join_2)  # -> Closed, Open; inputs C: Curve; same code as separate_curves_2

cabineoholedepth = ClusterInput()
subtraction = Subtraction(A=expression, B=cabineoholedepth)
indentdepth = ClusterInput()
subtraction_2 = Subtraction(A=subtraction, B=indentdepth)
txt_4 = Text(subtraction_2)
python_5 = GhPythonScript(crv=separate_curves.Arc, zBottom=txt_4, z=txt)  # -> a, b; same code as python_2
clean_4 = CleanTree(RemoveNulls=True, RemoveInvalid=True, RemoveEmpty=True, Tree=python_5.a)
project_2 = Project(Geometry=clean_4, Plane=PlaneXY(0, 0, 0))  # -> Geometry, Transform
indents = ClusterOutput(project_2.Geometry)

rearcutoff = ClusterInput()
clean_5 = CleanTree(RemoveNulls=True, RemoveInvalid=True, RemoveEmpty=True, Tree=separate_curves_2.Closed)
project_3 = Project(Geometry=clean_5, Plane=PlaneXY(0, 0, 0))  # -> Geometry, Transform
rearsheets = ClusterInput()
sheetoffset = VectorXYZ(XComponent=rearcutoff, YComponent=rearcutoff, ZComponent=0)  # -> Vector, Length
millingbitsize = ClusterInput()

ids = ClusterInput()
idtexts = IdTexts(x=ids, G=plates, Z=thickness)
idtexts_2 = ClusterOutput(idtexts)

sheets = ClusterOutput(rearsheets)

cabineoholedepth_2 = ClusterInput()
subtraction_3 = Subtraction(A=expression, B=cabineoholedepth_2)
txt_5 = Text(subtraction_3)
python_6 = GhPythonScript(crv=separate_curves.Arc, zTop=txt_5, z=txt)  # -> a; same code as python

python_7 = GhPythonScript(line=separate_curves.Line, zTop=txt_5, z=txt, lineLength=len)  # -> a
# ---------- python_7: Python ----------
__author__ = "alexa"
__version__ = "2019.10.04"

import rhinoscriptsyntax as rs

if z == zTop and lineLength < 1:
    a = line;
# ---------- end python_7 ----------

clean_6 = CleanTree(RemoveNulls=True, RemoveInvalid=True, RemoveEmpty=True, Tree=[python_6, python_7])
join_4 = JoinCurves(Curves=clean_6, Preserve=False)
separate_curves_5 = SeparateCurves(C=join_4)  # -> Closed, Open; inputs C: Curve; same code as separate_curves_2
separate_curves_6 = SeparateCurves(C=separate_curves_5.Open)  # -> PlanarCurve; inputs C: Curve
# ---------- separate_curves_6: VB ----------
    If Not C.IsArc()
      PlanarCurve = C
    End If
# ---------- end separate_curves_6 ----------
clean_7 = CleanTree(RemoveNulls=True, RemoveInvalid=True, RemoveEmpty=True, Tree=separate_curves_6)
closesockets = CloseSockets(millingbitsize=millingbitsize, C=clean_7)

project_4 = Project(Geometry=closesockets, Plane=PlaneXY(0, 0, 0))  # -> Geometry, Transform

cluster = Cluster_2(sheets=rearsheets)
sheetoffsets = ClusterInput()
neg = Negative(Value=rearcutoff)
vec = VectorXYZ(XComponent=neg, YComponent=neg, ZComponent=0)  # -> Vector, Length

clean_8 = CleanTree(RemoveNulls=True, RemoveInvalid=True, RemoveEmpty=True, Tree=separate_curves_4.Closed)
project_5 = Project(Geometry=clean_8, Plane=PlaneXY(0, 0, 0))  # -> Geometry, Transform
cluster_2 = Cluster_4(G=project_5.Geometry, G_2=project_3.Geometry)  # -> duplicates, unique

cluster_3 = Cluster_4(G=project_3.Geometry, G_2=project_5.Geometry)  # -> duplicates, unique

cluster_4 = Cluster_3(rearholes=cluster_3.unique, sheetleftbound=sheetoffsets)
item = ListItem(List=cluster, Index=cluster_4, Wrap=True)
move = Move(Geometry=cluster_3.unique, Motion=sheetoffset.Vector)  # -> Geometry, Transform
mirror = Mirror(Geometry=move.Geometry, Plane=item)  # -> Geometry, Transform
move_2 = Move(Geometry=mirror.Geometry, Motion=vec.Vector)  # -> Geometry, Transform
dim = Dimensions(Surface=mirror.Geometry)  # -> UDimension, VDimension
python_8 = GhPythonScript(size=dim.UDimension, inputIfSmaller=mirror.Geometry)  # -> output
# ---------- python_8: Python ----------
__author__ = "alexa"
__version__ = "2020.03.25"

import rhinoscriptsyntax as rs
if size < 15:
    output = inputIfSmaller
else:
    output = None
# ---------- end python_8 ----------
clean_9 = CleanTree(RemoveNulls=True, RemoveInvalid=True, RemoveEmpty=Toggle(True), Tree=python_8)
rearholes = ClusterOutput(clean_9)

dim_2 = Dimensions(Surface=cluster_2.unique)  # -> UDimension, VDimension
throughholes = ClusterOutput(cluster_3.duplicates)
python_9 = GhPythonScript(size=dim_2.UDimension, hole=cluster_2.unique)  # -> smallerthanfour, fourorlarger
# ---------- python_9: Python ----------
__author__ = "alexa"
__version__ = "2020.06.02"

import rhinoscriptsyntax as rs
if size < 4:
    smallerthanfour = hole
else:
    fourorlarger = hole
# ---------- end python_9 ----------
clean_10 = CleanTree(RemoveNulls=True, RemoveInvalid=True, RemoveEmpty=False, Tree=python_9.fourorlarger)
clean_11 = CleanTree(RemoveNulls=True, RemoveInvalid=True, RemoveEmpty=False, Tree=python_9.smallerthanfour)

drillholes = ClusterOutput(clean_10)

sockets = ClusterOutput(clean_11)

# ==== cluster Bake
thrroughholes = ClusterInput()
origins = ClusterInput()
sockets = ClusterInput()
idtexts = ClusterInput()
plates = ClusterInput()
indents = ClusterInput()
sheets = ClusterInput()
holes = ClusterInput()
rearholes = ClusterInput()
panel = Panel("""RearHoles
Holes
Sockets
Plates
Origins
IdTexts
Indents
Sheets
ThroughHoles""")
entwine = Entwine(
    Branch00=rearholes,
    Branch01=holes,
    Branch02=sockets,
    Branch03=plates,
    Branch04=origins,
    Branch05=idtexts,
    Branch06=indents,
    Branch07=sheets,
    Branch08=thrroughholes,
    FlattenInputs=True)
B = ClusterInput()
layer = DefineLayer(Name=panel)
attributes = DefineObjectAttributes(Layer=layer)
graft = GraftTree(Tree=attributes, IncludeEmptyLists=True, IncludeNullItems=True)
match = MatchTree(Tree=graft, Guide=entwine)
bake = BakeObjects(Geometry=entwine, Attributes=match, BakeName="elefront", Bake=B)

# ==== cluster Sheets
dimensions = ClusterInput()
ymargin = ClusterInput()
xmargin = ClusterInput()
rearcutoff = ClusterInput()
split = TextSplit(Text=dimensions, Separators="x")
addition = Addition(A=xmargin, B=rearcutoff)
flip = FlipMatrix(Data=split)
addition_2 = Addition(A=rearcutoff, B=ymargin)
bang = ExplodeTree(Data=flip)  # -> Branch0, Branch1
multiplication = Multiplication(A=addition, B="2")
multiplication_2 = Multiplication(A=addition_2, B="2")
subtraction = Subtraction(A=bang.Branch0, B=multiplication)
subtraction_2 = Subtraction(A=bang.Branch1, B=multiplication_2)
platezero = PlateZero(A=subtraction_2)  # -> L, G
multiplication_3 = Multiplication(A=rearcutoff, B="2")
subtraction_3 = Subtraction(A=bang.Branch0, B=multiplication_3)
subtraction_4 = Subtraction(A=bang.Branch1, B=multiplication_3)
rectangle = Rectangle(Plane=platezero.G, XSize=subtraction_3, YSize=subtraction_4, Radius=0)  # -> Rectangle, Length
vec = VectorXYZ(XComponent=rearcutoff, YComponent=rearcutoff, ZComponent=0)  # -> Vector, Length
vec_2 = VectorXYZ(XComponent=xmargin, YComponent=ymargin, ZComponent=0)  # -> Vector, Length
rectangle_2 = Rectangle(Plane=platezero.G, XSize=subtraction, YSize=subtraction_2, Radius=0)  # -> Rectangle, Length
move = Move(Geometry=rectangle.Rectangle, Motion=vec.Vector)  # -> Geometry, Transform
move_2 = Move(Geometry=rectangle_2.Rectangle, Motion=vec_2.Vector)  # -> Geometry, Transform
offsets = ClusterOutput(platezero.L)
frontsheets = ClusterOutput(move_2.Geometry)
rearsheets = ClusterOutput(move.Geometry)

# ==== cluster _2
x = ClusterInput()
times_2 = Expression(x=x, Expression="x/2")
R = ClusterOutput(times_2)

# ==== cluster Cluster
Z = ClusterInput()
Y = ClusterInput()

X = ClusterInput()
plate = CenterBox(Base=PlaneXY(0, 0, 0), X=X, Y=Y, Z=Z)
graft = GraftTree(Tree=plate, IncludeEmptyLists=True, IncludeNullItems=True)

xy = XYPlane(Origin=Point(0, 0, 0))
cutouts = ClusterInput()
python = GhPythonScript(cutouts=cutouts)  # -> type, x, y, xSize, ySize
# ---------- python: Python ----------
__author__ = "alexa"
__version__ = "2020.03.10"

import rhinoscriptsyntax as rs
if cutouts is not None:
    type = cutouts["type"]
    x = cutouts["x"]
    y = cutouts["y"]
    xSize = cutouts["xSize"]
    ySize = cutouts["ySize"]
# ---------- end python ----------
division = Division(A=python.ySize, B="2")
division_2 = Division(A=python.xSize, B="2")
vec = VectorXYZ(XComponent=expr("-X/2", python.xSize), YComponent=expr("-X/2", python.ySize), ZComponent=0)  # -> Vector, Length
multiplication = Multiplication(A="2", B=Z)
neg = Negative(Value=Z)
pt = ConstructPoint(XCoordinate=python.x, YCoordinate=python.y, ZCoordinate=graft(neg))
pl_origin = PlaneOrigin(Base=xy, Origin=pt)
ellipse = Ellipse(Plane=pl_origin, Radius1=division_2, Radius2=division)  # -> Ellipse, Focus1, Focus2
rectangle = Rectangle(Plane=pl_origin, XSize=python.xSize, YSize=python.ySize, Radius=0)  # -> Rectangle, Length
move = Move(Geometry=rectangle.Rectangle, Motion=vec.Vector)  # -> Geometry, Transform
python_2 = GhPythonScript(type=python.type, rectangle=move.Geometry, ellipse=ellipse.Ellipse)  # -> shape
# ---------- python_2: Python ----------
__author__ = "alexa"
__version__ = "2020.04.21"

import rhinoscriptsyntax as rs
if type == "ellipse":
    shape = ellipse
if type == "rectangle":
    shape = rectangle
# ---------- end python_2 ----------
vec_2 = VectorXYZ(XComponent=0, YComponent=0, ZComponent=multiplication)  # -> Vector, Length
boundary = BoundarySurfaces(Edges=python_2)

graft_2 = GraftTree(Tree=vec_2.Vector, IncludeEmptyLists=True, IncludeNullItems=True)

extr = Extrude(Base=boundary, Direction=graft_2)

sdiff = SolidDifference(BrepsA=graft, BrepsB=extr)
python_3 = GhPythonScript(plate=graft(graft), plateWithCutout=sdiff)  # -> outputPlate
# ---------- python_3: Python ----------
__author__ = "alexa"
__version__ = "2020.03.09"

import rhinoscriptsyntax as rs
if plateWithCutout is not None:
    outputPlate = plateWithCutout
else:
    outputPlate = plate
# ---------- end python_3 ----------
trim = TrimTree(Tree=python_3, Depth=1)
T = ClusterOutput(trim)

# ==== cluster CabineoSockets
zoffset = ClusterInput()
cabineoholedepth = ClusterInput()
cabineo_hole_distance = Slider(11.2, range=0..20)
sockets = ClusterInput()
cabineoside = ClusterInput()
cabineo_hole_size = Slider(2, range=0..20)
use15mmdrill = ClusterInput()
indentdepth = ClusterInput()
filter = StreamFilter(Gate=use15mmdrill, Stream0=Slider(15, range=0..100), Stream1=cabineo_hole_size)
cabineo_maker = CabineoMaker(
    holesize=filter,
    zoffset=zoffset,
    holedepth=cabineoholedepth,
    holedistance=cabineo_hole_distance,
    indentdepth=indentdepth,
    sockets=sockets,
    cabineoside=cabineoside)  # -> output, indents
sockets_2 = ClusterOutput(cabineo_maker.output)
indents = ClusterOutput(cabineo_maker.indents)

# ==== cluster DrillHoles
thickness = ClusterInput()
zoffset = ClusterInput()
subtraction = Subtraction(A=zoffset, B=thickness)
mounts = ClusterInput()
graft = GraftTree(Tree=zoffset, IncludeEmptyLists=True, IncludeNullItems=True)
addition = Addition(A=subtraction, B="12")
python = GhPythonScript(mount=mounts)  # -> x, y, type, diameter
# ---------- python: Python ----------
__author__ = "alexa"
__version__ = "2019.09.23"

import rhinoscriptsyntax as rs

if mount != None:
    x = mount["x"]
    y = mount["y"]
    type = mount["type"]
    diameter = mount["diameter"]
# ---------- end python ----------
graft_2 = GraftTree(Tree=addition, IncludeEmptyLists=True, IncludeNullItems=True)
python_2 = GhPythonScript(type=python.type, ifFromTop=graft, ifNotFromTop=graft_2, plateThickness=graft(thickness), stdHoleDepth="12")  # -> zOffset, holeDepth
# ---------- python_2: Python ----------
__author__ = "alexa"
__version__ = "2019.09.25"

import rhinoscriptsyntax as rs

if type == "top" or type == "through":
    zOffset = ifFromTop
else:
    zOffset = ifNotFromTop
if type == "top" or type == "bottom":
    holeDepth = stdHoleDepth
elif type == "through":
    holeDepth = plateThickness
# ---------- end python_2 ----------
pt = ConstructPoint(XCoordinate=python.x, YCoordinate=python.y, ZCoordinate=python_2.zOffset)
pdecon = Deconstruct(Point=pt)  # -> XComponent, YComponent, ZComponent
subtraction_2 = Subtraction(A=pdecon.ZComponent, B=python_2.holeDepth)
pt_2 = ConstructPoint(XCoordinate=pdecon.XComponent, YCoordinate=pdecon.YComponent, ZCoordinate=subtraction_2)
ln = Line(StartPoint=pt_2, EndPoint=pt)
division = Division(A=python.diameter, B="2")
pipe = Pipe(Curve=ln, Radius=division, Caps="1")
trim = TrimTree(Tree=pipe, Depth=1)
T = ClusterOutput(trim)

# ==== cluster HingeCups
length = ClusterInput()
depth = ClusterInput()
hingecups = ClusterInput()
thickness = ClusterInput()
expression = Expression(x=length, Expression="x")
expression_2 = Expression(x=depth, Expression="x")
python = GhPythonScript(hingeCup=hingecups)  # -> hingeType, hingeSide, hingeEdgeOffset
# ---------- python: Python ----------
__author__ = "alexa"
__version__ = "2019.09.23"

import rhinoscriptsyntax as rs

if hingeCup != None:
    hingeType = hingeCup["hingeType"]
    hingeSide = hingeCup["hingeSide"]
    hingeEdgeOffset = hingeCup["hingeEdgeOffset"]
# ---------- end python ----------
num = Number(expression)
num_2 = Number(expression_2)
python_2 = GhPythonScript(hingeEdgeOffset=python.hingeEdgeOffset, depth=graft(num_2))  # -> topCupYPosition, bottomCupYPosition
# ---------- python_2: Python ----------
__author__ = "alexa"
__version__ = "2020.02.13"

import rhinoscriptsyntax as rs
if (hingeEdgeOffset is not None):
    topCupYPosition = depth/2-hingeEdgeOffset
    bottomCupYPosition = -(depth/2)+hingeEdgeOffset
# ---------- end python_2 ----------
python_3 = GhPythonScript(hingeSide=python.hingeSide, cupEdgeDistance=Slider(19.5, range=0..100), length=graft(num))  # -> cupXPosition
# ---------- python_3: Python ----------
__author__ = "alexa"
__version__ = "2020.02.13"

import rhinoscriptsyntax as rs
if (hingeSide is None):
    cupXPosition = None
elif (hingeSide == "left"):
    cupXPosition = -(length/2)+cupEdgeDistance
else:
    cupXPosition = length/2 - cupEdgeDistance
# ---------- end python_3 ----------
expression_3 = Expression(x=thickness, Expression="x/2")
topcupcenter = ConstructPoint(XCoordinate=python_3, YCoordinate=python_2.topCupYPosition, ZCoordinate=graft(expression_3))
bottomcupcenter = ConstructPoint(XCoordinate=python_3, YCoordinate=python_2.bottomCupYPosition, ZCoordinate=graft(expression_3))
weave = Weave(Pattern=[0, 1], Stream0=topcupcenter, Stream1=bottomcupcenter, NullGaps=False)
cup = Cup(
    cupcenter=weave,
    platetopz="-11",
    cupradius="17.5",
    cupscrewoffset="6",
    cupscrewcc="48",
    cupscrewradius="2.5",
    cupscrewdepth="11",
    hingeside=python.hingeSide)
trim = TrimTree(Tree=cup, Depth=1)
T = ClusterOutput(trim)

# ==== cluster CloseSockets
C = ClusterInput()
millingbitsize = ClusterInput()
division = Division(A=millingbitsize, B=Slider(2, range=0..10))
openside = OpenSide(socket=C)  # -> right, left, bottom, top
neg = Negative(Value=division)
pt = ConstructPoint(XCoordinate=division, YCoordinate=0, ZCoordinate=0)
pt_2 = ConstructPoint(XCoordinate=neg, YCoordinate=0, ZCoordinate=0)
pt_3 = ConstructPoint(XCoordinate=0, YCoordinate=neg, ZCoordinate=0)
pt_4 = ConstructPoint(XCoordinate=0, YCoordinate=0, ZCoordinate=0)
pt_5 = ConstructPoint(XCoordinate=0, YCoordinate=division, ZCoordinate=0)
end = EndPoints(Curve=C)  # -> Start, End
addition = Addition(A=pt_4, B=pt)
python = GhPythonScript(bool=openside.right, ifTrue=addition, ifFalse=pt_4)  # -> r
# ---------- python: Python ----------
__author__ = "alexa"
__version__ = "2019.10.12"

import rhinoscriptsyntax as rs
if bool:
    r = ifTrue
else:
    r = ifFalse
# ---------- end python ----------
addition_2 = Addition(A=python, B=pt_2)
python_2 = GhPythonScript(bool=openside.left, ifTrue=addition_2, ifFalse=python)  # -> r; same code as python
addition_3 = Addition(A=python_2, B=pt_3)
python_3 = GhPythonScript(bool=openside.bottom, ifTrue=addition_3, ifFalse=python_2)  # -> r; same code as python
addition_4 = Addition(A=python_3, B=pt_5)
python_4 = GhPythonScript(bool=openside.top, ifTrue=addition_4, ifFalse=python_3)  # -> r; same code as python
addition_5 = Addition(A=python_4, B=end.Start)
addition_6 = Addition(A=python_4, B=end.End)
ln = Line(StartPoint=end.Start, EndPoint=addition_5)
ln_2 = Line(StartPoint=end.End, EndPoint=addition_6)
ln_3 = Line(StartPoint=addition_5, EndPoint=addition_6)
trim = TrimTree(Tree=ln, Depth=1)
trim_2 = TrimTree(Tree=ln_3, Depth=1)
trim_3 = TrimTree(Tree=ln_2, Depth=1)
merge = Merge(Data1=trim, Data2=trim_3, Data3=trim_2, Data4=C)
join = JoinCurves(Curves=merge, Preserve=False)
C_2 = ClusterOutput(join)

# ==== cluster IdTexts
x = ClusterInput()
G = ClusterInput()
python = GhPythonScript(x=x)  # -> a
# ---------- python: Python ----------
__author__ = "alexa"
__version__ = "2019.11.05"

import rhinoscriptsyntax as rs
if not x:
    a = y
else:
    a = x
# ---------- end python ----------
center = Center(Geometrical=G)  # -> Center, Dimension
Z = ClusterInput()
pt = ConstructPoint(XCoordinate=0, YCoordinate=0, ZCoordinate=Z)
addition = Addition(A=center.Center, B=pt)
text = Text(Location=addition, Text=python, Size="30")
C = ClusterOutput(text)

# ==== cluster Cluster_2
sheets = ClusterInput()
center = Center(Geometrical=sheets)  # -> Center, Dimension
pdecon = Deconstruct(Point=center.Center)  # -> XComponent, YComponent, ZComponent
pt = ConstructPoint(XCoordinate=pdecon.XComponent, YCoordinate=0, ZCoordinate=0)
pt_2 = ConstructPoint(XCoordinate=pdecon.XComponent, YCoordinate="1", ZCoordinate=0)
pt_3 = ConstructPoint(XCoordinate=pdecon.XComponent, YCoordinate=0, ZCoordinate="1")
pl_3pt = Plane3Pt(PointA=pt, PointB=pt_2, PointC=pt_3)
pl = ClusterOutput(pl_3pt)

# ==== cluster Cluster_3
rearholes = ClusterInput()
center = Center(Geometrical=rearholes, forall=False)  # -> Center, Dimension
sheetleftbound = ClusterInput()
pdecon = Deconstruct(Point=center.Center)  # -> XComponent, YComponent, ZComponent
python = GhPythonScript(x=pdecon.XComponent, y=sheetleftbound)  # -> a; inputs y: list
# ---------- python: Python ----------
__author__ = "alexa"
__version__ = "2019.11.06"

import rhinoscriptsyntax as rs

for i in range(len(y)):
    if (x > y[i]):
        a = i
# ---------- end python ----------
a = ClusterOutput(python)

# ==== cluster Cluster_4
G = ClusterInput()
G_2 = ClusterInput()
center = Center(Geometrical=G)  # -> Center, Dimension
center_2 = Center(Geometrical=G_2)  # -> Center, Dimension
pdecon = Deconstruct(Point=center.Center)  # -> XComponent, YComponent, ZComponent
pdecon_2 = Deconstruct(Point=center_2.Center)  # -> XComponent, YComponent, ZComponent
python = GhPythonScript(x=pdecon.XComponent, y=pdecon.YComponent)  # -> a
# ---------- python: Python ----------
__author__ = "alexa"
__version__ = "2020.05.31"

import rhinoscriptsyntax as rs
a = str(round(x,2)) + " " + str(round(y,2))
# ---------- end python ----------
python_2 = GhPythonScript(x=pdecon_2.XComponent, y=pdecon_2.YComponent)  # -> a; same code as python
flatten = FlattenTree(Tree=python_2, Path="{0}")
python_3 = GhPythonScript(geometry=G, center=python, toCheck=flatten)  # -> duplicates, unique; inputs toCheck: list
# ---------- python_3: Python ----------
__author__ = "alexa"
__version__ = "2020.05.31"

import rhinoscriptsyntax as rs
hasDuplicate = False
for elt in toCheck:
    if str(center) == str(elt):
        hasDuplicate = True
if hasDuplicate:
    duplicates = geometry
else:
    unique = geometry
# ---------- end python_3 ----------
clean = CleanTree(RemoveNulls=True, RemoveInvalid=True, RemoveEmpty=False, Tree=python_3.unique)
clean_2 = CleanTree(RemoveNulls=True, RemoveInvalid=True, RemoveEmpty=False, Tree=python_3.duplicates)
duplicates = ClusterOutput(clean_2)
unique = ClusterOutput(clean)

# ==== cluster PlateZero
A = ClusterInput()
addition = Addition(A=A, B=Slider(200, range=0..200))
number_slider = Slider(0, range=0..100)
ma = MassAddition(Input=addition)  # -> Result, PartialResults
ins = InsertItems(List=ma.PartialResults, Item=number_slider, Indices=number_slider, Wrap=True)
lng = ListLength(List=ins)
subtraction = Subtraction(A=lng, B=Slider(1, range=0..1))
cull_i = CullIndex(List=ins, Indices=subtraction, Wrap=True)
L = ClusterOutput(cull_i)
vec = VectorXYZ(XComponent=0, YComponent=cull_i, ZComponent=0)  # -> Vector, Length
xy = XYPlane(Origin=Point(0, 0, 0))
move = Move(Geometry=xy, Motion=vec.Vector)  # -> Geometry, Transform
G = ClusterOutput(move.Geometry)

# ==== cluster CabineoMaker
holedistance = ClusterInput()
sockets = ClusterInput()
holedepth = ClusterInput()
cabineoside = ClusterInput()
holesize = ClusterInput()
zoffset = ClusterInput()
indentdepth = ClusterInput()
cabineoholes = CabineoHoles(
    holedepth=holedepth,
    holesize=holesize,
    holedistance=holedistance,
    zoffset=zoffset,
    capboxheight="2.05",
    sockets=sockets,
    indentdepth=indentdepth,
    cabineoside=cabineoside)  # -> cabineoholes, indents
trim = TrimTree(Tree=cabineoholes.indents, Depth=1)
indents = ClusterOutput(trim)
output = ClusterOutput(cabineoholes.cabineoholes)

# ==== cluster Cup
platetopz = ClusterInput()
cupcenter = ClusterInput()
pt = ConstructPoint(XCoordinate=0, YCoordinate=0, ZCoordinate=platetopz)
cupscrewoffset = ClusterInput()
cupscrewradius = ClusterInput()
addition = Addition(A=cupcenter, B=pt)
expression = Expression(x=cupscrewoffset, Expression="x")
cupscrewcc = ClusterInput()
cupscrewdepth = ClusterInput()
hingeside = ClusterInput()
num = Number(expression)
ln = Line(StartPoint=cupcenter, EndPoint=addition)
cupradius = ClusterInput()
python = GhPythonScript(hingeSide=hingeside, screwOffset=num)  # -> screwXOffset
# ---------- python: Python ----------
__author__ = "alexa"
__version__ = "2020.02.13"

import rhinoscriptsyntax as rs
if (hingeSide == "left"):
    screwXOffset = screwOffset
elif (hingeSide == "right"):
    screwXOffset = -screwOffset
# ---------- end python ----------
expression_2 = Expression(x=cupscrewcc, Expression="x/2")
pipe = Pipe(Curve=ln, Radius=cupradius, Caps="1")
neg = Negative(Value=expression_2)
pt_2 = ConstructPoint(XCoordinate=python, YCoordinate=neg, ZCoordinate=0)
pt_3 = ConstructPoint(XCoordinate=python, YCoordinate=expression_2, ZCoordinate=0)
neg_2 = Negative(Value=cupscrewdepth)
addition_2 = Addition(A=cupcenter, B=pt_3)
addition_3 = Addition(A=cupcenter, B=pt_2)
merge = Merge(Data1=addition_2, Data2=addition_3)
pt_4 = ConstructPoint(XCoordinate=0, YCoordinate=0, ZCoordinate=neg_2)
addition_4 = Addition(A=merge, B=pt_4)
panel = Panel(pt_3)
ln_2 = Line(StartPoint=merge, EndPoint=addition_4)
pipe_2 = Pipe(Curve=ln_2, Radius=cupscrewradius, Caps="1")
cup = ClusterOutput([pipe, pipe_2])

# ==== cluster OpenSide
socket = ClusterInput()
end = EndPoints(Curve=socket)  # -> Start, End
bounds = Bounds(C=socket)  # -> right, left, top, bottom
pdecon = Deconstruct(Point=end.Start)  # -> XComponent, YComponent, ZComponent
expression = Expression(x=pdecon.YComponent, Expression="round(x*100)/100")
expression_2 = Expression(x=bounds.left, Expression="round(x*100)/100")
expression_3 = Expression(x=bounds.right, Expression="round(x*100)/100")
expression_4 = Expression(x=bounds.top, Expression="round(x*100)/100")
expression_5 = Expression(x=bounds.bottom, Expression="round(x*100)/100")
expression_6 = Expression(x=pdecon.XComponent, Expression="round(x*100)/100")
equals = Equality(FirstNumber=expression_3, SecondNumber=expression_6)  # -> Equality, Inequality
equals_2 = Equality(FirstNumber=expression_2, SecondNumber=expression_6)  # -> Equality, Inequality
equals_3 = Equality(FirstNumber=expression_5, SecondNumber=expression)  # -> Equality, Inequality
equals_4 = Equality(FirstNumber=expression_4, SecondNumber=expression)  # -> Equality, Inequality
bottom = ClusterOutput(equals_3.Equality)
right = ClusterOutput(equals.Equality)
left = ClusterOutput(equals_2.Equality)
top = ClusterOutput(equals_4.Equality)

# ==== cluster CabineoHoles
capboxheight = ClusterInput()
cabineoside = ClusterInput()
sockets = ClusterInput()
zoffset = ClusterInput()
holedistance = ClusterInput()
holesize = ClusterInput()
holedepth = ClusterInput()
expression = Expression(zOffset=zoffset, capBoxHeight=capboxheight, Expression="zOffset-capBoxHeight")
python = GhPythonScript(socket=sockets)  # -> x, y, direction, flushCap, rotate
# ---------- python: Python ----------
__author__ = "alexa"
__version__ = "2019.09.23"

import rhinoscriptsyntax as rs

if socket != None:
    x = socket["x"]
    y = socket["y"]
    direction = socket["direction"]
    flushCap = socket["flushCap"]
    rotate = socket["rotate"]
# ---------- end python ----------
python_2 = GhPythonScript(ifTrue=expression, ifFalse=zoffset)  # -> zOffset
# ---------- python_2: Python ----------
__author__ = "alexa"
__version__ = "2019.09.23"

import rhinoscriptsyntax as rs

if flushCap:
    zOffset = ifTrue
else:
    zOffset = ifFalse
# ---------- end python_2 ----------
expression_2 = Expression(zOffset=python_2, holeDepth=holedepth, Expression="zOffset-holeDepth")
python_3 = GhPythonScript(xOffset=python.x, direction=python.direction, rotate=python.rotate)  # -> R
# ---------- python_3: Python ----------
__author__ = "alexa"
__version__ = "2019.09.25"

import rhinoscriptsyntax as rs

if xOffset != None:
    if not rotate:
        R = xOffset+3.6*direction
    else:
        R = xOffset
else:
    R = None
# ---------- end python_3 ----------
python_4 = GhPythonScript(yOffset=python.y, direction=python.direction, rotate=python.rotate)  # -> R
# ---------- python_4: Python ----------
__author__ = "alexa"
__version__ = "2019.09.25"

import rhinoscriptsyntax as rs

if yOffset != None: 
    if rotate:
        R = yOffset+3.6*direction
    else:
        R = yOffset
else:
    R = None
# ---------- end python_4 ----------
graft = GraftTree(Tree=expression_2, IncludeEmptyLists=True, IncludeNullItems=True)
cabineo_hole_1_pt = ConstructPoint(XCoordinate=python_3, YCoordinate=python_4, ZCoordinate=graft)
next_hole = NextHole(direction=python.direction, offset=holedistance, P=cabineo_hole_1_pt, rotate=python.rotate)
next_hole_2 = NextHole(direction=python.direction, offset=holedistance, P=next_hole, rotate=python.rotate)
pdecon = Deconstruct(Point=next_hole)  # -> XComponent, YComponent, ZComponent
expression_3 = Expression(x=holedepth, Expression="x/2")

expression_4 = Expression(x=holedepth, Expression="-x")
expression_5 = Expression(x=holedistance, Expression="x")
cabineo_hole_1_pt_2 = ConstructPoint(XCoordinate=0, YCoordinate=0, ZCoordinate=expression_4)
pt = ConstructPoint(XCoordinate=expr("x", expression_5), YCoordinate=0, ZCoordinate=0)
addition = Addition(A=cabineo_hole_1_pt_2, B=pt)
addition_2 = Addition(A=addition, B=pt)
pt_2 = ConstructPoint(XCoordinate=0, YCoordinate=0, ZCoordinate=expression_3)
cabineo_hole = CabineoHole(holedepth=holedepth, pt=[cabineo_hole_1_pt_2, addition_2, addition], x=holesize)  # -> flatten(P)
addition_3 = Addition(A=addition, B=pt_2)
xy = XYPlane(Origin=addition_3)
box = CenterBox(Base=xy, X=Slider(10, range=0..100), Y=Slider(5.1, range=0..10), Z=expression_3)
sunion = SolidUnion(Breps=[cabineo_hole, box])

indentdepth = ClusterInput()
addition_4 = Addition(A=expression_3, B=pdecon.ZComponent)
item = ListItem(List=next_hole_2, Index=graft(cabineoside), Wrap=True)
pt_3 = ConstructPoint(XCoordinate=pdecon.XComponent, YCoordinate=pdecon.YComponent, ZCoordinate=addition_4)
cabineo_hole_2 = CabineoHole(holedepth=holedepth, pt=[cabineo_hole_1_pt, next_hole_2, next_hole], x=holesize)
placementindent = PlacementIndent(holedepth=holedepth, A=item, indentdepth=indentdepth)
xy_2 = XYPlane(Origin=pt_3)
python_5 = GhPythonScript(rotate=python.rotate, boxWidth=Slider(5.1, range=0..10), boxLength=Slider(10, range=0..100))  # -> X, Y
# ---------- python_5: Python ----------
__author__ = "alexa"
__version__ = "2020.04.24"

import rhinoscriptsyntax as rs
if rotate:
    X = boxWidth
    Y = boxLength
else:
    X = boxLength
    Y = boxWidth
# ---------- end python_5 ----------
trim = TrimTree(Tree=cabineo_hole_2, Depth=1)
indents = ClusterOutput(placementindent)
box_2 = CenterBox(Base=xy_2, X=python_5.X, Y=python_5.Y, Z=expression_3)
sunion_2 = SolidUnion(Breps=trim)
cabineoholes = ClusterOutput(sunion_2)

# ==== cluster Bounds
C = ClusterInput()
bbox = BoundingBox(Content=C, Plane=PlaneXY(0, 0, 0))  # -> Box, Box_2
debox = DeconstructBox(Box=bbox.Box)  # -> Plane, X, Y, Z
num = Number(debox.X)
num_2 = Number(debox.Y)
center = Center(Geometry=bbox.Box)  # -> Center, Dimension
expression = Expression(x=num, Expression="x/2")
expression_2 = Expression(x=num_2, Expression="x/2")
pt = Point(center.Center)
pdecon = Deconstruct(Point=pt)  # -> XComponent, YComponent, ZComponent
addition = Addition(A=pdecon.XComponent, B=expression)
addition_2 = Addition(A=pdecon.YComponent, B=expression_2)
subtraction = Subtraction(A=pdecon.YComponent, B=expression_2)
subtraction_2 = Subtraction(A=pdecon.XComponent, B=expression)
bottom = ClusterOutput(subtraction)
top = ClusterOutput(addition_2)
left = ClusterOutput(subtraction_2)
right = ClusterOutput(addition)

# ==== cluster NextHole
direction = ClusterInput()
offset = ClusterInput()
P = ClusterInput()
rotate = ClusterInput()
pdecon = Deconstruct(Point=P)  # -> XComponent, YComponent, ZComponent
pdecon_2 = Deconstruct(Point=P)  # -> XComponent, YComponent, ZComponent
expression = Expression(direction=direction, offset=offset, original=pdecon_2.XComponent, Expression="original+offset*direction")
expression_2 = Expression(direction=direction, offset=offset, original=pdecon.YComponent, Expression="original+offset*direction")
pt = ConstructPoint(XCoordinate=pdecon.XComponent, YCoordinate=expression_2, ZCoordinate=pdecon.ZComponent)
pt_2 = ConstructPoint(XCoordinate=expression, YCoordinate=pdecon_2.YComponent, ZCoordinate=pdecon_2.ZComponent)
python = GhPythonScript(rotate=rotate, ifTrue=pt, ifFalse=pt_2)  # -> point
# ---------- python: Python ----------
__author__ = "alexa"
__version__ = "2019.09.23"

import rhinoscriptsyntax as rs

if rotate:
    point = ifTrue
else:
    point = ifFalse
# ---------- end python ----------
point = ClusterOutput(python)

# ==== cluster CabineoHole
holedepth = ClusterInput()
pt = ClusterInput()
pt_2 = Point(pt)
toppoint = Cluster(HoleDepth=holedepth, Point=pt_2)
x = ClusterInput()
ln = Line(StartPoint=toppoint, EndPoint=pt_2)
expression = Expression(x=x, Expression="x/2")
list = ValueList({"One": 1, "Two": 2, "Three": 2² - 1, "Four": Sqrt(16)}, selected="One")
pipe = Pipe(Curve=ln, Radius=expression, Caps=list)
P = ClusterOutput(pipe)

# ==== cluster PlacementIndent
indentdepth = ClusterInput()
A = ClusterInput()
holedepth = ClusterInput()
pt = ConstructPoint(XCoordinate=0, YCoordinate=0, ZCoordinate=indentdepth)
subtraction = Subtraction(A=A, B=pt)
python = GhPythonScript(x=A, y=subtraction)  # -> a
# ---------- python: Python ----------
__author__ = "alexa"
__version__ = "2019.12.13"

import rhinoscriptsyntax as rs
if (x is not None):
    a = y
else:
    a = None
# ---------- end python ----------
cabineo_hole = Cluster(HoleDepth=holedepth, BasePoint=python, HoleSize="5")
P = ClusterOutput(cabineo_hole)
